# Grasshopper definition ClimateOrientedDesign.gh (Grasshopper 1.0.7)
# plug-ins: PollinationGH, Ironbug.LBHB_Legacy

panel = Panel("http://climate.onebuilding.org/WMO_Region_5_Southwest_Pacific/AUS_Australia/NSW_New_South_Wales/AUS_NSW_Sydney.Obs-Obsservatory.Hill.947680_TMYx.zip")
downloadepw = LBDownloadWeather(weather_URL=panel)  # -> epw_file, stat_file, ddy_file; plug-in component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
wea = HBWeaFromEPW(epw_file=downloadepw.epw_file)  # -> wea; plug-in component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

# ----
# Assign Rhino layers
# to match Pipelines
pipeline = GeometryPipeline(
    GroupByLayer=False,
    GroupByType=False,
    IncludeHidden=True,
    IncludeLocked=True,
    LayerFilter="GlassHor",
    NameFilter="*",
    SublayerFiltering=True,
    TypeFilter=1073741848)
pipeline_2 = GeometryPipeline(
    GroupByLayer=False,
    GroupByType=False,
    IncludeHidden=True,
    IncludeLocked=True,
    LayerFilter="TestArea",
    NameFilter="*",
    SublayerFiltering=True,
    TypeFilter=1073741848)
pipeline_3 = GeometryPipeline(
    GroupByLayer=False,
    GroupByType=False,
    IncludeHidden=True,
    IncludeLocked=True,
    LayerFilter="Geo",
    NameFilter="*",
    SublayerFiltering=True,
    TypeFilter=1073741848)
pipeline_4 = GeometryPipeline(
    GroupByLayer=False,
    GroupByType=False,
    IncludeHidden=True,
    IncludeLocked=True,
    LayerFilter="GlassVert",
    NameFilter="*",
    SublayerFiltering=True,
    TypeFilter=1073741848)
# MAKE SURE RHINO MODEL IS IN M AND SIZING IS CORRECT
pipeline_5 = GeometryPipeline(
    GroupByLayer=False,
    GroupByType=False,
    IncludeHidden=True,
    IncludeLocked=True,
    LayerFilter="Sur",
    NameFilter="*",
    SublayerFiltering=True,
    TypeFilter=1073741848)

month = Slider(1, range=1..2, expression="x*6")
hour = Slider(8, range=8..16)

# ----
# Setup an hour for glare image simulation
button = Button()
fly = Ladybug_fly(inputSliders=hour, fly=button)  # -> Vviiiiiiiiiizzz; inputs inputSliders: list, fly: Boolean; plug-in component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

# ----
# Set a centre point and scale for sun puth
pt = Point(Point(952.9544972, 437.2724864, 4.813730214))

# ----
# Set a day/month
panel_2 = Panel("17")
series = Series(Start="7", Step=1, Count=panel_2)

# ----
# Sun Hours
importepw = LBImportEPW(epw_file=downloadepw.epw_file)  # -> location, dry_bulb_temperature, dew_point_temperature, relative_humidity, wind_speed, wind_direction, direct_normal_rad, diffuse_horizontal_rad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; plug-in component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
hoy = LBCalculateHOY(month="6", day="21", hour=graft(series))  # -> flatten(hoy), flatten(doy), flatten(date); plug-in component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
legendpar = LBLegendParameters(min="5", max="30", seg_count="11", num_decimals="1", vert_or_horiz=Toggle(True), seg_height="0.5", seg_width="0.5")  # -> leg_par; plug-in component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
importloc = LBImportLocation(epw_file=downloadepw.epw_file)  # -> location; plug-in component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

# ----
# Set Winter and
# Summer separatelly
panel_3 = Panel("12")

lb_analysis_period = LBAnalysisPeriod(start_month=panel_3, start_day=1, start_hour=0, end_month="2")  # -> period, hoys, dates; plug-in component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

# ----
# Preview SunPath in Rhino
sunpath = LBSunPath(
    location=importloc,
    hoys=hoy.hoy,
    center_pt=pt,
    scale=Slider(100, range=0..100),
    data=importepw.dry_bulb_temperature,
    legend_par=legendpar)  # -> report, vectors, altitudes, azimuths, hoys, sun_pts, analemma, daily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; plug-in component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

# ----
# Preview Wind Rose in Rhino
lb_wind_rose = LBWindRose(data=importepw.wind_speed, wind_direction=importepw.wind_direction, period=lb_analysis_period.period)  # -> report, mesh, compass, orient_line, freq_line, windrose_line, legend, title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; plug-in component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

# ----
# Connect correct geometry
# to Run Sun Hours Analysis
pipeline_6 = GeometryPipeline(
    GroupByLayer=False,
    GroupByType=False,
    IncludeHidden=True,
    IncludeLocked=True,
    LayerFilter="Geo",
    NameFilter="*",
    SublayerFiltering=True,
    TypeFilter=1073741848)

shade = HBShade(geo=pipeline_5)  # -> report, shades; plug-in component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
face = HBFace(geo=pipeline_3, name="OLP")  # -> report, faces; plug-in component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

# ----
# Daylight
# Change grid size if 1m is too small
panel_4 = Panel("Glass2")
glassmod = HBGlassModifier(name="Glass", trans="0.2")  # -> modifier; plug-in component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
genpts = LBGeneratePointGrid(geometry=pipeline_2, grid_size="1", offset_dist="0.1", quad_only=Toggle(True))  # -> points, vectors, face_areas, graft(mesh); plug-in component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
sensorgrid = HBSensorGrid(name="Station", positions=genpts.points, directions=genpts.vectors, mesh=genpts.mesh)  # -> grid; plug-in component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
viewport = HBViewFromViewport(name="View2", viewport="View2", view_type=Slider(1, range=0..5), refresh=Button())  # -> view; plug-in component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

glassmod_2 = HBGlassModifier(name=panel_4, trans="0.5")  # -> modifier; plug-in component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
face_2 = HBFace(geo=pipeline, name="Glass", rad_mod=glassmod)  # -> report, faces; plug-in component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
room = HBRoom(faces=flatten([face.faces, face_2.faces]), conditioned=True)  # -> report, room; plug-in component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

aperture = HBAperture(geo=pipeline_4, name=panel_4, rad_mod=glassmod_2)  # -> report, apertures; plug-in component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

model = HBModel(rooms=flatten(room.room), shades=flatten(shade.shades), apertures=flatten(aperture.apertures))  # -> report, model; plug-in component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

assigngridsviews = HBAssignGridsAndViews(model=model.model, grids=flatten(sensorgrid), views=flatten(viewport))  # -> model; plug-in component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

# ----
# Review LBT model
# in rhino window
vizall = HBVizualizeAll(hb_objs=flatten(model.model))  # -> geo; plug-in component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

# ----
# Login with this component
setup_runs = SetupRuns(
    _model=assigngridsviews,
    _wea=wea,
    Grid_filter_="*",
    North_="0",
    Radiance_par_="-ab 2 -ad 5000 -lw 2e-05",
    Sensor_count_=200,
    Thresholds_="-t 160 -ut 2000 -lt 80",
    Owner="ladybug-tools",
    RecipeJsonString="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",
    project="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")

# ----
# Visual Comfort Analysis
# Annual
toggle = BooleanToggle(False)
annualdaylight = HBAnnualDaylight(model=assigngridsviews, wea=wea, thresholds="-t 160 -ut 2000 -lt 80", run=toggle)  # -> report, results, DA, cDA, UDI, UDI_low, UDI_up; plug-in component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
mjoin = MeshJoin(Meshes=flatten(genpts.mesh))

colrange = LBColorRange(index=Slider(6, range=0..25))  # -> colors; plug-in component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
legendpar_2 = LBLegendParameters(min="0", max="100", colors=colrange)  # -> leg_par; plug-in component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
heatmap = LBSpatialHeatmap(
    values=flatten(annualdaylight.UDI_up),
    mesh=mjoin,
    legend_par=legendpar_2,
    legend_title="% of time",
    global_title="ASE(2000)")  # -> mesh, legend, title, colors, legend_par; plug-in component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

# ----
# DGP - Glare (point in time)
panel_5 = Panel("C:\Users\BOG94192\simulation\unnamed")
concat = Concatenate(FragmentA=month, FragmentB=hour)
concat_2 = Concatenate(FragmentA=panel_5, FragmentC="\", FragmentB=concat)
radpar = HBRadianceParameter(recipe_type="1", additional_par="-ab 4")  # -> rad_par; plug-in component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
recipesettings = HBRecipeSettings(folder=concat_2, reload_old=False)  # -> settings; plug-in component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
climatebased = HBClimatebasedSky(wea=wea, month=month, day="21", hour=hour)  # -> sky; plug-in component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
pitview = HBPointInTimeViewBased(
    model=assigngridsviews,
    sky=climatebased,
    metric=Slider(2, range=0..3),
    resolution="1000",
    radiance_par=radpar,
    run_settings=recipesettings,
    run=Toggle(False))  # -> report, results; plug-in component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
glare = HBGlarePostprocess(hdr=pitview.results)  # -> DGP, category, glare_indices, check_hdr; plug-in component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

legendpar_3 = LBLegendParameters(min="0", max="100")  # -> leg_par; plug-in component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
heatmap_2 = LBSpatialHeatmap(values=flatten(annualdaylight.DA), mesh=mjoin, legend_par=legendpar_3, legend_title="% of time", global_title="DI(160)")  # -> mesh, legend, title, colors, legend_par; plug-in component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

concat_3 = Concatenate(FragmentC=concat, FragmentA=" DGP ", FragmentB=glare.DGP)
adjusthdr = HBAdjustHDR(hdr=glare.check_hdr, adj_expos=Toggle(True), label=concat_3, label_hgt="50")  # -> hdr; plug-in component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
hdr_gif = HBHDRToGIF(hdr=adjusthdr)  # -> gif; plug-in component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
imageviewer = Ladybug_ImageViewer(ImagePath_=hdr_gif, _scale_=1, DisableClickable=False, SaveImgWithCoords=False, scale=1)  # -> ImagePath, Values, GIF
python = GhPythonScript(x=imageviewer.ImagePath, y=Toggle(True))  # -> out, a
# ---------- python: Python ----------
__author__ = "BOG94192"
__version__ = "2021.07.29"

import rhinoscriptsyntax as rs

from os.path import dirname
import os,shutil

file = os.path.basename(x)
parent = dirname(dirname(dirname(x)))
new_name = os.path.basename(parent)

if y == True:
    shutil.copyfile(x,os.path.join(dirname(parent),new_name+".gif"))
    a = os.path.join(dirname(parent),new_name+".gif")
else:
    pass
# ---------- end python ----------

# ----
# Glare images are saved here
panel_6 = Panel(python.a)

# ----
# Visual Comfort Analysis | Cloud
# Annual
panel_7 = Panel("Development")
mjoin_2 = MeshJoin(Meshes=flatten(genpts.mesh))
panel_8 = Panel("C:\Users\BOG94192\OneDrive - Mott MacDonald\Projects\EDS\SMW\SOP\211110")

# ----
# Press Pollinate and results
# will appear to the right,
# when simulation is done
pollinate = Pollinate(
    _runs=flatten(setup_runs),
    _name_="OLP",
    Description_="Daylight",
    Sub_folder_=panel_7,
    Keywords_="Daylight",
    CUPNumber=2,
    IfEnabledRemoteRun=False,
    RunLocal=False,
    liveUpdateStatus=True)

check_job_status = CheckJobStatus(_job=pollinate, Index_=0, getBothInputOutputAssets=False, liveUpdateStatus=True)
check_run_results = CheckRunResults(
    _run=check_job_status,
    recipeSource="https://api.pollination.cloud/registries/ladybug-tools/recipe/annual-daylight/0.5.9")  # -> CDA, DA, Metrics, Results, UDI, UDI_low, UDI_up
load_assets = LoadAssets(
    Folder_=panel_8,
    DA=check_run_results.DA,
    UDI_up=check_run_results.UDI_up,
    liveUpdateStatus=True,
    postprocessWithHandler=True,
    useCachedAssets=True)  # -> Logs, DA, UDI_up

larger = LargerThan(FirstNumber=flatten(load_assets.UDI_up), SecondNumber="20")  # -> LargerThan, OrEqualTo
colrange_2 = LBColorRange(index="6")  # -> colors; plug-in component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
lng = ListLength(List=flatten(load_assets.UDI_up))
ma = MassAddition(Input=larger.OrEqualTo)  # -> Result, PartialResults
legendpar_4 = LBLegendParameters(min="0", max="100", colors=colrange_2)  # -> leg_par; plug-in component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
division = Division(A=ma.Result, B=lng)
multiplication = Multiplication(A=division, B=100)

colrange_3 = LBColorRange()  # -> colors; plug-in component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
larger_2 = LargerThan(FirstNumber=flatten(load_assets.DA), SecondNumber="80")  # -> LargerThan, OrEqualTo
lng_2 = ListLength(List=flatten(load_assets.DA))
ma_2 = MassAddition(Input=larger_2.OrEqualTo)  # -> Result, PartialResults
rev = ReverseList(List=colrange_3)
legendpar_5 = LBLegendParameters(min="0", max="100", colors=rev)  # -> leg_par; plug-in component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
division_2 = Division(A=ma_2.Result, B=lng_2)
multiplication_2 = Multiplication(A=division_2, B=100)
concat_4 = Concatenate(FragmentA="DI (160/80) ", FragmentB=multiplication_2)

concat_5 = Concatenate(FragmentA="ASE (2000/20) ", FragmentB=multiplication)

# ----
# Preview Daylight Results in Rhino
# and save graphics
heatmap_3 = LBSpatialHeatmap(values=flatten(load_assets.DA), mesh=mjoin_2, legend_par=legendpar_5, legend_title="% of time", global_title=concat_4)  # -> mesh, legend, title, colors, legend_par; plug-in component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

# ----
# Preview Overexposure Results
# in Rhino and save graphics
heatmap_4 = LBSpatialHeatmap(
    values=flatten(load_assets.UDI_up),
    mesh=mjoin_2,
    legend_par=legendpar_4,
    legend_title="% of time",
    global_title=concat_5)  # -> mesh, legend, title, colors, legend_par; plug-in component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

# ----
# Set  a day from the left -
# sun path hoys_ input
panel_9 = Panel("5")
colrange_4 = LBColorRange(index=panel_9)  # -> colors; plug-in component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
legendpar_6 = LBLegendParameters(min="0", max="12", seg_count="13", colors=colrange_4, vert_or_horiz=Toggle(False))  # -> leg_par; plug-in component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
toggle_2 = BooleanToggle(False)

# ----
# Perview Sun Hours Results
wires = BrepWireframe(Brep=pipeline_3, Density=-1)
directsunhours = LBDirectSunHours(
    vectors=flatten(sunpath.vectors),
    geometry=flatten(pipeline_3),
    context=flatten(pipeline_5),
    grid_size="1",
    offset_dist="0.1",
    legend_par=legendpar_6,
    parallel=toggle_2,
    run=toggle_2)  # -> report, points, results, mesh, legend, title, int_mtx; plug-in component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

mesh = Mesh(directsunhours.mesh)
