# Grasshopper definition Week4_Daylight_LB-Legacy.gh (Grasshopper 1.0.7)
# plug-ins: Sasquatch

# Follow the flow from left to right.
# White boxes are for you review only, to see what's inside the components.
# 
# Adjust yellow boxes to suite specific requirements.
ladybug = Ladybug_Ladybug()  # -> Vviiiiiiiiiizzz; plug-in component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
honeybee = Honeybee_Honeybee()  # -> Vviiiiiiiiiizzz; plug-in component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

# ----
# Climate input
panel = Panel("http://climate.onebuilding.org/WMO_Region_5_Southwest_Pacific/AUS_Australia/NSW_New_South_Wales/AUS_NSW_Mascot-Sydney.Kingsford.Smith.AP.947670_56_MA_CZ0513_RMY2012B.zip")
epw_stat = Ladybug_OpenEPWAndSTATWeatherFiles(weatherFileURL=panel)  # -> epwFile, statFile; plug-in component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
importepw = Ladybug_ImportEpw(epwFile=epw_stat.epwFile)  # -> readMe, latitude, location, dryBulbTemperature, dewPointTemperature, relativeHumidity, windSpeed, windDirection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; plug-in component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

# ----
# Solid Geometry
pipeline = GeometryPipeline(
    GroupByLayer=False,
    GroupByType=False,
    IncludeHidden=True,
    IncludeLocked=True,
    LayerFilter="Box",
    NameFilter="*",
    SublayerFiltering=True,
    TypeFilter=1073741848)
brep = Brep(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)
split2floors = Honeybee_SplitBuildingMass2Floors(bldgMasses=brep, bldgsFlr2FlrHeights="@3", runIt=Toggle(True))  # -> readMe, flatten(splitBldgFloors); plug-in component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
radopaquematerial = Honeybee_RadianceOpaqueMaterial(materialName="External", RReflectance="0.5", GReflectance="0.5", BReflectance="0.5", roughness=0.05, specularity=0)  # -> avrgRef, RADMaterial; plug-in component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
createhbsrfs = Honeybee_createHBSrfs(geometry=split2floors.splitBldgFloors, srfName="External", RADMaterial=radopaquematerial.RADMaterial)  # -> readMe, simplify(HBSurface); plug-in component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

# ----
# Glazing
number_slider = Slider(0.5, range=0..1)
glzparamlist = Honeybee_GlazingParametersList(
    northGlzParam=number_slider,
    westGlzParam=Slider(0.2, range=0..1),
    southGlzParam=Slider(0.1, range=0..1),
    eastGlzParam=Slider(0.3, range=0..1))  # -> glzParamList; plug-in component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
radglassmaterial = Honeybee_RadianceGlassMaterial(materialName="Glazing", RTransmittance="0.5", GTransmittance="0.5", BTransmittance="0.5", refractiveIndex=1.52)  # -> avrgTrans, RADMaterial; plug-in component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
glazingcreator = Honeybee_GlazingBasedOnRatio(
    HBObjects=createhbsrfs.HBSurface,
    glzRatio=glzparamlist,
    breakUpWindow=Toggle(True),
    sillHeight="1.1",
    RADMaterials=radglassmaterial.RADMaterial,
    runIt=Toggle(True))  # -> readMe, HBObjWGLZ; plug-in component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

panel_2 = Panel(glazingcreator.HBObjWGLZ)

# ----
# Shading
panel_3 = Panel("Open Brep")
tmatch = MatchText(Text=flatten(glazingcreator.HBObjWGLZ), Pattern=panel_3, Case=True)
cull = CullPattern(List=flatten(glazingcreator.HBObjWGLZ), CullPattern=tmatch)
debrep = DeconstructBrep(Brep=cull)  # -> Faces, Edges, Vertices
relast = RemoveLastItem(List=debrep.Faces, NumberOfItems=1)
panel_4 = Panel("""0.5
0.5
0.5
0.5""")
shddesigner = Ladybug_ShadingDesigner(
    glzSrf=flatten(relast),
    depthOrVector=flatten(Slider(1, range=0..1)),
    runIt=Toggle(True),
    port_4=False,
    horOrVertical=Toggle(True))  # -> readMe, flatten(shadingSrfs); plug-in component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
radopaquematerial_2 = Honeybee_RadianceOpaqueMaterial(materialName="Shading", RReflectance="0.7", GReflectance="0.7", BReflectance="0.7", roughness=0.05, specularity=0)  # -> avrgRef, RADMaterial; plug-in component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
createhbsrfs_2 = Honeybee_createHBSrfs(geometry=shddesigner.shadingSrfs, RADMaterial=radopaquematerial_2.RADMaterial)  # -> readMe, simplify(HBSurface); plug-in component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

panel_5 = Panel(tmatch)
panel_6 = Panel(cull)
panel_7 = Panel(debrep.Faces)
panel_8 = Panel(relast)

# ----
# Area of Analysis
pipeline_2 = GeometryPipeline(
    GroupByLayer=False,
    GroupByType=False,
    IncludeHidden=True,
    IncludeLocked=True,
    LayerFilter="TestArea",
    NameFilter="*",
    SublayerFiltering=True,
    TypeFilter=1073741848)
brep_2 = Brep(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)
gentestpts = Honeybee_GenerateTestPoints(testGeometry=brep_2, gridSize="5", distBaseSrf="0.8", moveTestMesh=True)  # -> readMe, simplify(testPoints), simplify(ptsVectors), simplify(facesArea), simplify(mesh); plug-in component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

# ----
# Prerape Analysis Recipe
number_slider_2 = Slider(0, range=0..2)
radparameters = Honeybee_RADParameters(quality=number_slider_2)  # -> readMe, radParameters; plug-in component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
annualdaylightsimulation = Honeybee_AnnualDaylightSimulation(
    epwWeatherFile=epw_stat.epwFile,
    testPoints=gentestpts.testPoints,
    ptsVectors=gentestpts.ptsVectors,
    testMesh=gentestpts.mesh,
    radParameters=radparameters.radParameters)  # -> analysisRecipe; plug-in component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

# ----
# Double click to run
# the simulation
toggle = BooleanToggle(False)
rundaylightanalysis = Honeybee_RunDaylightSimulation(
    HBObjects=flatten([glazingcreator.HBObjWGLZ, createhbsrfs_2.HBSurface]),
    analysisRecipe=annualdaylightsimulation,
    writeRad=toggle,
    runRad=toggle,
    overwriteResults=True)  # -> readMe, analysisType, resultsUnit, results, testPts, resultFiles, radGeoFile, studyFolder, done; plug-in component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
panel_9 = Panel(rundaylightanalysis.resultFiles)

# ----
# Period of Assesment
panel_10 = Panel("17")
analysisperiod = Ladybug_AnalysisPeriod(fromHour="9", toHour=panel_10)  # -> readMe, analysisPeriod; plug-in component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
occupancygenerator = Honeybee_DaysimOccupancyGenerator(occupancyPeriod=analysisperiod.analysisPeriod, dailyOffHours="13", weekendDays="0", writeTheOcc=Toggle(True))  # -> occupancyFile; plug-in component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

# ----
# Read Results
toggle_2 = BooleanToggle(True)
readannualresultsi = Honeybee_ReadAnnualResultI(
    illFilesAddress=rundaylightanalysis.resultFiles,
    testPoints=simplify(gentestpts.testPoints),
    ptsVectors=gentestpts.ptsVectors,
    occupancyFiles=occupancygenerator,
    DLAIllumThresholds="160",
    runIt=toggle_2)  # -> DLA, UDLI_Less_100, UDLI_100_2000, UDLI_More_2000, CDA, sDA, annualProfiles, htmReport; plug-in component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
panel_11 = Panel(readannualresultsi.sDA)
panel_12 = Panel(readannualresultsi.DLA)

# ----
# Show results in Rhino
# Graphically
panel_13 = Panel("100")
legendpar = Ladybug_LegendParameters(lowBound="0", highBound=panel_13, numSegments="11")  # -> legendPar; plug-in component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
recolormesh = Ladybug_RecolorMesh(
    analysisResult=readannualresultsi.DLA,
    inputMesh=gentestpts.mesh,
    legendPar=legendpar,
    analysisTitle="sDA(160lux)",
    legendTitle="% time")  # -> readMe, newMesh, newLegend, legendBasePt, meshColors, legendColors; plug-in component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
