# Grasshopper definition Week4_Daylight_LB1.1.0.gh (Grasshopper 1.0.7)

# ----
# Weather file
panel = Panel("http://climate.onebuilding.org/WMO_Region_5_Southwest_Pacific/AUS_Australia/NSW_New_South_Wales/AUS_NSW_Mascot-Sydney.Kingsford.Smith.AP.947670_56_MA_CZ0513_RMY2012B.zip")
downloadepw = LBDownloadWeather(weather_URL=panel)  # -> epw_file, stat_file, ddy_file; plug-in component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
wea = HBWeaFromEPW(epw_file=downloadepw.epw_file)  # -> wea; plug-in component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

# ----
# Geometry Preparation
pipeline = GeometryPipeline(
    GroupByLayer=False,
    GroupByType=False,
    IncludeHidden=True,
    IncludeLocked=True,
    LayerFilter="Default",
    NameFilter="*",
    SublayerFiltering=True,
    TypeFilter=1073741848)
geo = Geometry([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])
roomsolid = HBRoomFromSolid(geo=flatten(geo), name="Box", conditioned=True)  # -> report, rooms; plug-in component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
opaquemod = HBOpaqueModifier(name="Box", reflect="0.5")  # -> modifier; plug-in component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
applyfacemod = HBApplyFaceModifier(hb_objs=flatten(roomsolid.rooms), mod=opaquemod)  # -> hb_objs; plug-in component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

# ----
# Glazing
number_slider = Slider(0.4, range=0..1)
number_slider_2 = Slider(0.2, range=0..1)
facparam = HBFacadeParameters(north=number_slider, east=number_slider_2, south=number_slider, west=number_slider_2)  # -> fac_par; plug-in component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
aperturesbyratio = HBAperturesByRatio(hb_objs=flatten(applyfacemod), ratio=facparam, win_height="1.8", sill_height="1.1")  # -> report, hb_objs; plug-in component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
glassmod = HBGlassModifier(name="Glass", trans="0.55")  # -> modifier; plug-in component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
applywindowmod = HBApplyWindowModifier(hb_objs=flatten(aperturesbyratio.hb_objs), mod=glassmod)  # -> hb_objs; plug-in component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

# ----
# Shading
number_slider_3 = Slider(0.7, range=0..1)
louvershades = HBLouverShades(hb_objs=flatten(applywindowmod), depth=number_slider_3)  # -> report, hb_objs; plug-in component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
opaquemod_2 = HBOpaqueModifier(name="WallThickness", reflect="0.7")  # -> modifier; plug-in component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
applyshademod = HBApplyShadeModifier(hb_objs=flatten(louvershades.hb_objs), mod=opaquemod_2)  # -> hb_objs; plug-in component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
opaquemod_3 = HBOpaqueModifier(name="WallThickness", reflect="0.5")  # -> modifier; plug-in component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
bordershades = HBExtrudedBorderShades(hb_objs=flatten(applyshademod), depth="-0.3", rad_mod=opaquemod_3)  # -> report, hb_objs; plug-in component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

# ----
# Area of Analysis
panel_2 = Panel("sample_model_grid")
gridrooms = HBSensorGridFromRooms(rooms=bordershades.hb_objs, grid_size="1", dist_floor="0.8")  # -> grid, points, mesh; plug-in component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
model = HBModel(rooms=flatten(bordershades.hb_objs), name=panel_2)  # -> report, model; plug-in component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
assigngridsviews = HBAssignGridsAndViews(model=model.model, grids=flatten(gridrooms.grid))  # -> model; plug-in component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
vizwiref = HBVizualizeWireframe(hb_objs=flatten(model.model))  # -> geo; plug-in component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
vizall = HBVizualizeAll(hb_objs=flatten(model.model))  # -> geo; plug-in component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

# ----
# Visualise  model in Rhino
vizbytype = HBVisualizeByType(hb_objs=model.model)  # -> walls, interior_walls, roofs, ceilings, exterior_floors, interior_floors, air_walls, apertures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; plug-in component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
# Double click to run
# the simulation
toggle = BooleanToggle(False)

# ----
# Run Recipe
panel_3 = Panel("30")
annualdaylight = HBAnnualDaylight(model=assigngridsviews, wea=wea, north=0, sensor_count=panel_3, radiance_parameters=" ")  # -> recipe; plug-in component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
runrecipe = HBRunRecipe(recipe=annualdaylight, run=toggle)  # -> report, results; plug-in component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

# ----
# Parse
# Results
panel_4 = Panel("160")
annualmetrics = HBAnnualDaylightMetrics(results=runrecipe.results, threshold=panel_4)  # -> report, DA, UDI; plug-in component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
panel_5 = Panel(annualmetrics.DA)

# ----
# Visualize
# Results
panel_6 = Panel("100")
legendpar = LBLegendParameters(min="0", max=panel_6, seg_count="11")  # -> leg_par; plug-in component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
# Period of Assesment
# Read Results
# Show results in Rhino
# Graphically
heatmap = LBSpatialHeatmap(values=annualmetrics.DA, mesh=gridrooms.mesh, legend_par=legendpar, legend_title="% time", global_title="DA(160lux)")  # -> mesh, legend, title, colors, legend_par; plug-in component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
