# Grasshopper definition Week5_VisualComfort_LB-Legacy.gh (Grasshopper 1.0.7)
# plug-ins: treesloth01, Ironbug.LBHB_Legacy, Sasquatch

# Follow the flow from left to right.
# White boxes are for you review only, to see what's inside the components.
# 
# Adjust yellow boxes to suite specific requirements.
ladybug = Ladybug_Ladybug()  # -> Vviiiiiiiiiizzz; plug-in component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
honeybee = Honeybee_Honeybee()  # -> Vviiiiiiiiiizzz; plug-in component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

# ----
# Climate input
panel = Panel("http://climate.onebuilding.org/WMO_Region_5_Southwest_Pacific/AUS_Australia/NSW_New_South_Wales/AUS_NSW_Mascot-Sydney.Kingsford.Smith.AP.947670_56_MA_CZ0513_RMY2012B.zip")
epw_stat = Ladybug_OpenEPWAndSTATWeatherFiles(weatherFileURL=panel)  # -> epwFile, statFile; plug-in component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
importepw = Ladybug_ImportEpw(epwFile=epw_stat.epwFile)  # -> readMe, latitude, location, dryBulbTemperature, dewPointTemperature, relativeHumidity, windSpeed, windDirection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; plug-in component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

# ----
# Solid Geometry
pipeline = GeometryPipeline(
    GroupByLayer=False,
    GroupByType=False,
    IncludeHidden=True,
    IncludeLocked=True,
    LayerFilter="Box",
    NameFilter="*",
    SublayerFiltering=True,
    TypeFilter=1073741848)
brep = Brep(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)
split2floors = Honeybee_SplitBuildingMass2Floors(bldgMasses=brep, bldgsFlr2FlrHeights="@3", runIt=Toggle(True))  # -> readMe, flatten(splitBldgFloors); plug-in component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
radopaquematerial = Honeybee_RadianceOpaqueMaterial(materialName="External", RReflectance="0.5", GReflectance="0.5", BReflectance="0.5", roughness=0.05, specularity=0)  # -> avrgRef, RADMaterial; plug-in component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
createhbsrfs = Honeybee_createHBSrfs(geometry=split2floors.splitBldgFloors, srfName="External", RADMaterial=radopaquematerial.RADMaterial)  # -> readMe, simplify(HBSurface); plug-in component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

# ----
# Glazing
number_slider = Slider(0.5, range=0..1)
glzparamlist = Honeybee_GlazingParametersList(
    northGlzParam=number_slider,
    westGlzParam=Slider(0.2, range=0..1),
    southGlzParam=Slider(0.1, range=0..1),
    eastGlzParam=Slider(0.3, range=0..1))  # -> glzParamList; plug-in component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
radglassmaterial = Honeybee_RadianceGlassMaterial(materialName="Glazing", RTransmittance="0.5", GTransmittance="0.5", BTransmittance="0.5", refractiveIndex=1.52)  # -> avrgTrans, RADMaterial; plug-in component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
glazingcreator = Honeybee_GlazingBasedOnRatio(
    HBObjects=createhbsrfs.HBSurface,
    glzRatio=glzparamlist,
    breakUpWindow=Toggle(True),
    sillHeight="1.1",
    RADMaterials=radglassmaterial.RADMaterial,
    runIt=Toggle(True))  # -> readMe, HBObjWGLZ; plug-in component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

panel_2 = Panel(glazingcreator.HBObjWGLZ)

# ----
# Shading
panel_3 = Panel("Open Brep")
tmatch = MatchText(Text=flatten(glazingcreator.HBObjWGLZ), Pattern=panel_3, Case=True)
cull = CullPattern(List=flatten(glazingcreator.HBObjWGLZ), CullPattern=tmatch)
debrep = DeconstructBrep(Brep=cull)  # -> Faces, Edges, Vertices
relast = RemoveLastItem(List=debrep.Faces, NumberOfItems=1)
panel_4 = Panel("""0.5
0.5
0.5
0.5""")
shddesigner = Ladybug_ShadingDesigner(
    glzSrf=flatten(relast),
    depthOrVector=flatten(Slider(1, range=0..1)),
    runIt=Toggle(True),
    port_4=False,
    horOrVertical=Toggle(True))  # -> readMe, flatten(shadingSrfs); plug-in component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
radopaquematerial_2 = Honeybee_RadianceOpaqueMaterial(materialName="Shading", RReflectance="0.7", GReflectance="0.7", BReflectance="0.7", roughness=0.05, specularity=0)  # -> avrgRef, RADMaterial; plug-in component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
createhbsrfs_2 = Honeybee_createHBSrfs(geometry=shddesigner.shadingSrfs, RADMaterial=radopaquematerial_2.RADMaterial)  # -> readMe, simplify(HBSurface); plug-in component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

panel_5 = Panel(tmatch)
panel_6 = Panel(cull)
panel_7 = Panel(debrep.Faces)
panel_8 = Panel(relast)

# ----
# Area of Analysis
pipeline_2 = GeometryPipeline(
    GroupByLayer=False,
    GroupByType=False,
    IncludeHidden=True,
    IncludeLocked=True,
    LayerFilter="TestArea",
    NameFilter="*",
    SublayerFiltering=True,
    TypeFilter=1073741848)
brep_2 = Brep(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)
gentestpts = Honeybee_GenerateTestPoints(testGeometry=brep_2, gridSize="5", distBaseSrf="0.8", moveTestMesh=True)  # -> readMe, simplify(testPoints), simplify(ptsVectors), simplify(facesArea), simplify(mesh); plug-in component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

# ----
# Prerape Analysis Recipe
number_slider_2 = Slider(0, range=0..2)
radparameters = Honeybee_RADParameters(quality=number_slider_2)  # -> readMe, radParameters; plug-in component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
annualdaylightsimulation = Honeybee_AnnualDaylightSimulation(
    epwWeatherFile=epw_stat.epwFile,
    testPoints=gentestpts.testPoints,
    ptsVectors=gentestpts.ptsVectors,
    testMesh=gentestpts.mesh,
    radParameters=radparameters.radParameters)  # -> analysisRecipe; plug-in component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

# ----
# Double click to run
# the simulation
toggle = BooleanToggle(False)
rundaylightanalysis = Honeybee_RunDaylightSimulation(
    HBObjects=flatten([glazingcreator.HBObjWGLZ, createhbsrfs_2.HBSurface]),
    analysisRecipe=annualdaylightsimulation,
    writeRad=toggle,
    runRad=toggle,
    overwriteResults=True)  # -> readMe, analysisType, resultsUnit, results, testPts, resultFiles, radGeoFile, studyFolder, done; plug-in component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
panel_9 = Panel(rundaylightanalysis.resultFiles)

# ----
# Period of Assesment
panel_10 = Panel("9")
analysisperiod = Ladybug_AnalysisPeriod(fromHour=panel_10, toHour="17")  # -> readMe, analysisPeriod; plug-in component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
occupancygenerator = Honeybee_DaysimOccupancyGenerator(occupancyPeriod=analysisperiod.analysisPeriod, dailyOffHours="13", weekendDays="0", writeTheOcc=Toggle(True))  # -> occupancyFile; plug-in component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

# ----
# Read Results
toggle_2 = BooleanToggle(True)
readannualresultsi = Honeybee_ReadAnnualResultI(
    illFilesAddress=rundaylightanalysis.resultFiles,
    testPoints=simplify(gentestpts.testPoints),
    ptsVectors=gentestpts.ptsVectors,
    occupancyFiles=occupancygenerator,
    DLAIllumThresholds="160",
    runIt=toggle_2)  # -> DLA, UDLI_Less_100, UDLI_100_2000, UDLI_More_2000, CDA, sDA, annualProfiles, htmReport; plug-in component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
panel_11 = Panel(readannualresultsi.sDA)
panel_12 = Panel(readannualresultsi.DLA)

# ----
# Geometry for SunHours and SolarRadiation analysis
# (no glazing)
panel_13 = Panel("Untrimmed Surface")
tmatch_2 = MatchText(Text=flatten(glazingcreator.HBObjWGLZ), Pattern=panel_13, Case=True)
cull_2 = CullPattern(List=flatten(glazingcreator.HBObjWGLZ), CullPattern=tmatch_2)
first_last = FirstLast(List=debrep.Faces)  # -> FirstValue, LastValue
brep_3 = Brep([first_last.LastValue, createhbsrfs_2.HBSurface, cull_2])

# ----
# Glare (image based) recipe
number_slider_3 = Slider(12, range=1..12)
radparameters_2 = Honeybee_RADParameters(quality="0", ab="4")  # -> readMe, radParameters; plug-in component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
genclimatebasedsky = Honeybee_GenerateClimateBasedSky(weatherFile=epw_stat.epwFile, month=number_slider_3, day="21", hour=Slider(7, range=7..18))  # -> radiationValues, skyFilePath; plug-in component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
imagebasedsimulation = Honeybee_ImageBasedSimulation(
    skyFile=genclimatebasedsky.skyFilePath,
    rhinoViewsName="Perspective",
    cameraType=Slider(1, range=0..2),
    simulationType=2,
    radParameters=radparameters_2.radParameters,
    backupImages=0)  # -> analysisRecipe; plug-in component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

# ----
# Show results in Rhino
# Graphically
panel_14 = Panel("0")
legendpar = Ladybug_LegendParameters(lowBound=panel_14, highBound="100", numSegments="11")  # -> legendPar; plug-in component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
concat = Concatenate(FragmentA="DA(160lux/50%time) ", FragmentB=readannualresultsi.sDA)
recolormesh = Ladybug_RecolorMesh(
    analysisResult=readannualresultsi.DLA,
    inputMesh=gentestpts.mesh,
    legendPar=legendpar,
    analysisTitle=concat,
    legendTitle="% time")  # -> readMe, newMesh, newLegend, legendBasePt, meshColors, legendColors; plug-in component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

# ----
# Glare Analysis
# Find your image here:
# (Right click > Copy Data Only)
# Double click to run
# the simulation
toggle_3 = BooleanToggle(False)
rundaylightanalysis_2 = Honeybee_RunDaylightSimulation(
    HBObjects=flatten([glazingcreator.HBObjWGLZ, createhbsrfs_2.HBSurface]),
    analysisRecipe=imagebasedsimulation,
    writeRad=toggle_3,
    runRad=toggle_3,
    overwriteResults=True)  # -> readMe, analysisType, resultsUnit, results, testPts, resultFiles, radGeoFile, studyFolder, done; plug-in component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
glareanalysis = Honeybee_GlareAnalysis(HDRImagePath=rundaylightanalysis_2.resultFiles, runIt=Toggle(True))  # -> readMe, glareCheckImage, DGP, DGI, glareComfortRange, imageWithTaskArea; plug-in component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
hdr_gif = Honeybee_ConvertHDRToGIF(HDRFilePath=glareanalysis.glareCheckImage, adjustExposure=Toggle(True))  # -> GIFFilePath; plug-in component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
imageviewer = Ladybug_ImageViewer(ImagePath_=hdr_gif, _scale_=1, DisableClickable=True, SaveImgWithCoords=False, scale=1)  # -> ImagePath, Values, GIF
panel_15 = Panel(hdr_gif)

# ----
# Adjust Analysis Period
number_slider_4 = Slider(7, range=7..18)
series = Series(Start=number_slider_4, Step=1, Count="12")

# ----
# Solar Radiation
toggle_4 = BooleanToggle(True)
gencumulativeskymtx = Ladybug_GenCumulativeSkyMtx(epwFile=epw_stat.epwFile, skyDensity=0, useOldRes=True, runIt=toggle_4)  # -> readMe, cumulativeSkyMtx; plug-in component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
selectskymtx = Ladybug_selectSkyMtx(
    cumulativeSkyMtx=gencumulativeskymtx.cumulativeSkyMtx,
    analysisPeriod=analysisperiod.analysisPeriod,
    removeDiffuse=False,
    removeDirect=False)  # -> readMe, selectedSkyMtx; plug-in component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
radiationanalysis = Ladybug_RadiationAnalysis(
    geometry=flatten(brep_2),
    context=flatten(brep_3),
    gridSize="5",
    disFromBase="0.8",
    selectedSkyMtx=flatten(selectskymtx.selectedSkyMtx),
    runIt=Toggle(False))  # -> readMe, contextMesh, analysisMesh, testPts, testVec, port, radiationResult, radiationMesh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; plug-in component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

# ----
# Sun Hours
sunpath = Ladybug_SunPath(location=importepw.location, hour=series, day="21", month=Slider(12, range=1..12), timeStep=1, dailyOrAnnualSunPath=True)  # -> readMe, sunVectors, sunAltitudes, sunAzimuths, port, sunSpheresMesh, sunPathCrvs, compassCrvs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; plug-in component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
sunlighthoursanalysis = Ladybug_SunlightHoursAnalysis(
    geometry=flatten(brep_2),
    context=flatten(brep_3),
    gridSize="5",
    disFromBase="0.8",
    sunVectors=flatten(sunpath.sunVectors),
    timeStep=1,
    runIt=Toggle(False))  # -> readMe, contextMesh, analysisMesh, testPts, testVec, port, sunlightHoursResult, sunlightHoursMesh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; plug-in component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
