# Grasshopper definition Week7_UTCI_LBT-v1.1.0.gh (Grasshopper 1.0.7)

# ----
# Import Weather file
panel = Panel("http://climate.onebuilding.org/WMO_Region_5_Southwest_Pacific/AUS_Australia/NSW_New_South_Wales/AUS_NSW_Mascot-Sydney.Kingsford.Smith.AP.947670_56_MA_CZ0513_RMY2012B.zip")
downloadepw = LBDownloadWeather(weather_URL=panel)  # -> epw_file, stat_file, ddy_file; plug-in component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
importepw = LBImportEPW(epw_file=downloadepw.epw_file)  # -> location, dry_bulb_temperature, dew_point_temperature, relative_humidity, wind_speed, wind_direction, direct_normal_rad, diffuse_horizontal_rad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; plug-in component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

# ----
# 'view factor calc'
# Import Context and analysis geo
number_slider = Slider(0.1, range=0..0.1)
brep = Brep([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])
brep_2 = Brep(<brep referenced from the Rhino model>)
toggle = BooleanToggle(True)
pt = Point(Point(1.324035726, 13.75394255, 0))
genpts = LBGeneratePointGrid(geometry=brep_2, grid_size=Slider(10, range=0..10), offset_dist=number_slider)  # -> points, vectors, face_areas, graft(mesh); plug-in component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
humantosky = LBHumanToSkyRelation(location=importepw.location, position=flatten(genpts.points), context=flatten(brep), run=toggle)  # -> report, human_points, human_line, fract_body_exp, sky_exposure; plug-in component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

solarbodypar = LBSolarBodyParameters()  # -> sol_body_par; plug-in component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

# ----
# Mean Radient Temp calc
toggle_2 = BooleanToggle(False)
outdoorsolarmrt = LBOutdoorSolarMRT(
    location=importepw.location,
    surface_temp=importepw.dry_bulb_temperature,
    dir_norm_rad=importepw.direct_normal_rad,
    diff_horiz_rad=importepw.diffuse_horizontal_rad,
    horiz_infrared=importepw.horizontal_infrared_rad,
    fract_body_exp=humantosky.fract_body_exp,
    sky_exposure=humantosky.sky_exposure,
    run=toggle)  # -> report, short_erf, long_erf, short_dmrt, long_dmrt, mrt; plug-in component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

# ----
# UTCI calc
toggle_3 = BooleanToggle(False)
utci = LBUTCIComfort(
    air_temp=importepw.dry_bulb_temperature,
    mrt=outdoorsolarmrt.mrt,
    rel_humid=importepw.relative_humidity,
    wind_vel=importepw.wind_speed,
    run=toggle)  # -> report, utci, comfort, condition, category, comf_obj; plug-in component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

# ----
# Results presentation
# Type 1
comfstat = LBComfortStatistics(comf_obj=utci.comf_obj)  # -> pct_hot, pct_neutral, pct_cold; plug-in component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
hourlyplot = LBHourlyPlot(data=utci.category)  # -> report, mesh, legend, borders, labels, title; plug-in component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

# ----
# Results presentation
# Type 2
panel_2 = Panel("8")
analysisperiod = LBAnalysisPeriod(start_month="12", start_day=1, start_hour=panel_2, end_month="2", end_hour="18")  # -> period, hoys, dates; plug-in component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
applyper = LBApplyAnalysisPeriod(data=utci.utci, period=analysisperiod.period)  # -> data; plug-in component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
xdata = LBDeconstructData(data=applyper)  # -> header, values; plug-in component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
legendpar = LBLegendParameters(min="22.5", max="25")  # -> leg_par; plug-in component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
avr = Average(Input=xdata.values)  # -> flatten(ArithmeticMean)
heatmap = LBSpatialHeatmap(values=avr, mesh=genpts.mesh, legend_par=legendpar)  # -> mesh, legend, title, colors, legend_par; plug-in component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
