# Grasshopper definition Week9_EnergyModeling.gh (Grasshopper 1.0.7)

# ----
# Base Geometry
r_value = Panel("2")
brep = Brep([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])
brep_2 = Brep(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)
number_slider = Slider(0.6, range=0..1)
r_value_2 = Panel("0.5")
division = Division(A="0.3", B=r_value)
division_2 = Division(A="0.2", B=r_value_2)
opaquemat = HBOpaqueMaterial(name="Wall", thickness="0.3", conductivity=division, density="2000", spec_heat="920", sol_absp=number_slider)  # -> mat; plug-in component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
opaquemod = HBOpaqueModifier(name="Wall", reflect=Slider(0.5, range=0..1))  # -> modifier; plug-in component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
opaquemat_2 = HBOpaqueMaterial(name="Wall", thickness="0.2", conductivity=division_2, density="5000", spec_heat="670", sol_absp=number_slider)  # -> mat; plug-in component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
opaqueconstr = HBOpaqueConstruction(name="CurtainWall", materials=opaquemat_2)  # -> constr; plug-in component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
opaqueconstr_2 = HBOpaqueConstruction(name="Solid", materials=opaquemat)  # -> constr; plug-in component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
face = HBFace(geo=brep, name="CurtainWall", ep_constr=opaqueconstr, rad_mod=opaquemod)  # -> report, faces; plug-in component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
face_2 = HBFace(geo=brep_2, name="Solid", ep_constr=opaqueconstr_2, rad_mod=opaquemod)  # -> report, faces; plug-in component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

# ----
# Windows geometry and materials
number_slider_2 = Slider(0.4, range=0..1)
facparam = HBFacadeParameters(north=number_slider_2, east=number_slider_2, south=0, west=number_slider_2)  # -> fac_par; plug-in component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
windowmat = HBWindowMaterial(
    name="Glazing",
    u_factor=Slider(1.1, range=0.5..5),
    shgc=Slider(0.23, range=0.2..1.2),
    t_vis=Slider(0.48, range=0.2..1.2))  # -> mat; plug-in component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
aperturesbyratio = HBAperturesByRatio(hb_objs=flatten(face.faces), ratio=facparam, sill_height="0.4", operable=Toggle(False))  # -> report, hb_objs; plug-in component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
windowconstr = HBWindowConstruction(name="Glazing", materials=windowmat)  # -> constr; plug-in component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
applywindowconstr = HBApplyWindowConstruction(hb_objs=flatten(aperturesbyratio.hb_objs), constr=windowconstr)  # -> hb_objs; plug-in component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

# ----
# Shading geometry and materials
number_slider_3 = Slider(1, range=1..10)
louvershades = HBLouverShades(hb_objs=flatten(applywindowconstr), depth=Slider(0.5, range=0..1.5), shade_count=number_slider_3)  # -> report, hb_objs; plug-in component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
shadeconstr = HBShadeConstruction(name="Shading")  # -> constr; plug-in component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
applyshadeconstr = HBApplyShadeConstruction(hb_objs=flatten(louvershades.hb_objs), constr=shadeconstr)  # -> hb_objs; plug-in component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

building_class = Panel("""Class 2 Common Area
Class 3 Hotel
Class 5 building, 7 warehouse, 8 Labs, 9a clinic
Class 6 Shop/Shopping Centre
Class 6 Restautant/Cafe
Class 9a Ward
Class 9b Theather/Cinema
Class 9b Conference Facility
Class 9b School""")
item = ListItem(List=building_class, Index="2", Wrap=True)
lb_v1_1_0 = LBV110(S=building_class, M=item)  # -> weeksched, schedule_4, schedule_3, weeksched_5, schedule_5, weeksched_4, schedule, weeksched_3, schedule_2, weeksched_2

# ----
# Visual preview
faceenergyattr = HBFaceEnergyAttributes({"Construction": "properties.energy.construction.display_name", "Materials": "properties.energy.construction.layers", "R-Value": "properties.energy.construction.r_value", "U-Value": "properties.energy.construction.u_value", "U-Factor": "properties.energy.construction.u_factor", "Solar Transmitance [Unshaded]": "properties.energy.construction.solar_transmittance", "Solar Reflectance [Outside]": "properties.energy.construction.outside_solar_reflectance", "Solar Reflectance [Inside]": "properties.energy.construction.inside_solar_reflectance", "Fraction Area Operable": "properties.energy.vent_opening.fraction_area_operable", "Fraction Height Operable": "properties.energy.vent_opening.fraction_height_operable", "Discharge Coefficient": "properties.energy.vent_opening.discharge_coefficient", "Cross Ventilation": "properties.energy.vent_opening.wind_cross_vent"}, selected="U-Value")
facesbytype = HBFacesByType(hb_objs=applyshadeconstr)  # -> walls, interior_walls, roofs, ceilings, exterior_floors, interior_floors, air_walls, apertures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; plug-in component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
vizall = HBVizualizeAll(hb_objs=flatten(applyshadeconstr))  # -> geo; plug-in component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
lablefaces = HBLabelFaces(hb_objs=flatten(facesbytype.apertures), attribute=faceenergyattr, sub_faces=Toggle(True))  # -> label_text, base_pts, labels, wire_frame; plug-in component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

# ----
# Assign a program and loads
bldgprograms = HBBuildingPrograms({"LargeOffice", "MediumOffice", "SmallOffice", "MidriseApartment", "HighriseApartment", "Retail", "StripMall", "PrimarySchool", "SecondarySchool", "SmallHotel", "LargeHotel", "Hospital", "Outpatient", "Laboratory", "Warehouse", "SuperMarket", "FullServiceRestaurant", "QuickServiceRestaurant", "Courthouse", "LargeDataCenterHighITE", "LargeDataCenterLowITE", "SmallDataCenterHighITE", "SmallDataCenterLowITE"}, selected="LargeOffice")
people = HBPeople(name="People", ppl_per_area=Slider(0.1, range=0..0.1), occupancy_sch=lb_v1_1_0.schedule_4)  # -> people; plug-in component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
searchprog = HBSearchPrograms(bldg_prog=bldgprograms, keywords="Open")  # -> room_prog; plug-in component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
lighting = HBLighting(name="Lighting", watts_per_area="5", schedule=lb_v1_1_0.schedule_3)  # -> lighting; plug-in component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
infiltration = HBInfiltration(flow_per_ext_area="0.0003", schedule=lb_v1_1_0.schedule_2)  # -> infil; plug-in component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
programtype = HBProgramType(base_program=searchprog, people=people, lighting=lighting, infiltration=infiltration)  # -> program; plug-in component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

# ----
# Set to TRUE and assign
# HVAC if mechanically
# conditioned
toggle = BooleanToggle(False)
room = HBRoom(faces=flatten([face_2.faces, applyshadeconstr]), name="TestBox", program=programtype, conditioned=toggle)  # -> report, room; plug-in component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

# ----
# Select results to review
toggle_2 = BooleanToggle(True)
simoutput = HBSimulationOutput(gains_and_losses=toggle_2, comfort_metrics=toggle_2, surface_temperature=toggle_2, surface_energy_flow=toggle_2)  # -> report, sim_output; plug-in component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
panel = Panel("https://www.energyplus.net/weather-download/southwest_pacific_wmo_region_5/AUS//AUS_NSW.Sydney.947670_IWEC/all")
downloadepw = LBDownloadWeather(weather_URL=panel)  # -> epw_file, stat_file, ddy_file; plug-in component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
model = HBModel(rooms=flatten(room.room))  # -> report, model; plug-in component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
simpar = HBSimulationParameter(output=simoutput.sim_output, timestep=6, terrain="City")  # -> sim_par; plug-in component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
toggle_3 = BooleanToggle(True)
modeltoosm = HBModelToOSM(model=model.model, epw_file=downloadepw.epw_file, sim_par=simpar, write=toggle_3, run=toggle_3)  # -> report, jsons, osw, osm, idf, sql, zsz, rdd, html; plug-in component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

# ----
# Set period of assessment
# 2.1 Set level
# 2.2 Set WWR
# per orientation
# 2.3 Set window thermal
# and visual properties
# 2.1 Set level
# 2.2 Set WWR
# per orientation
# 2.3 Set window thermal
# and visual properties
panel_2 = Panel("18")
faceresult = HBReadFaceResult(sql=modeltoosm.sql)  # -> face_indoor_temp, face_outdoor_temp, face_energy_flow; plug-in component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
roomenergyresult = HBReadRoomEnergyResult(sql=modeltoosm.sql)  # -> cooling, heating, lighting, electric_equip, gas_equip, hot_water, fan_electric, pump_electric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; plug-in component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
analysisperiod = LBAnalysisPeriod(start_month=1, start_day=1, start_hour="8", end_hour=panel_2)  # -> period, hoys, dates; plug-in component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

# ----
# Collect the results
applyper = LBApplyAnalysisPeriod(data=faceresult.face_energy_flow, period=analysisperiod.period)  # -> data; plug-in component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
applyper_2 = LBApplyAnalysisPeriod(data=roomenergyresult.people_gain, period=analysisperiod.period)  # -> data; plug-in component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
applyper_3 = LBApplyAnalysisPeriod(data=roomenergyresult.solar_gain, period=analysisperiod.period)  # -> data; plug-in component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
applyper_4 = LBApplyAnalysisPeriod(data=roomenergyresult.infiltration_load, period=analysisperiod.period)  # -> data; plug-in component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
normbyflr = HBNormalizeByFloorArea(data=applyper_2, model=model.model)  # -> total_data, room_data; plug-in component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
normbyflr_2 = HBNormalizeByFloorArea(data=applyper_4, model=model.model)  # -> total_data, room_data; plug-in component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
normbyflr_3 = HBNormalizeByFloorArea(data=applyper_3, model=model.model)  # -> total_data, room_data; plug-in component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
xdata = LBDeconstructData(data=applyper)  # -> header, values; plug-in component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
flip = FlipMatrix(Data=xdata.values)
xdata_2 = LBDeconstructData(data=normbyflr.room_data)  # -> header, values; plug-in component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
xdata_3 = LBDeconstructData(data=normbyflr_3.room_data)  # -> header, values; plug-in component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
xdata_4 = LBDeconstructData(data=normbyflr_2.room_data)  # -> header, values; plug-in component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
ma = MassAddition(Input=flip)  # -> Result, PartialResults
ma_2 = MassAddition(Input=xdata_2.values)  # -> Result, PartialResults
ma_3 = MassAddition(Input=xdata_3.values)  # -> Result, PartialResults
ma_4 = MassAddition(Input=xdata_4.values)  # -> Result, PartialResults
ma_5 = MassAddition(Input=flatten([ma_2.Result, ma_3.Result, ma_4.Result]))  # -> Result, PartialResults

# ----
# View results
colorfaces = HBColorFaces(data=flatten(faceresult.face_energy_flow), hb_objs=flatten(room.room))  # -> report, mesh, wire_frame, legend, title, faces, colors, values; plug-in component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
panel_3 = Panel(ma_5.Result)

# ==== cluster LBV110
M = ClusterInput()
S = ClusterInput()
mindex = MemberIndex(Set=S, Member=M)  # -> Index, Count
concat = Concatenate(FragmentA="{0;", FragmentB=mindex.Index, FragmentC="}")
class_5_building_class_7_warehouse_class = Panel("""0.25
0.25
0.25
0.25
0.25
0.25
0.25
0.65
0.80
1
1
1
1
1
1
1
1
0.80
0.65
0.55
0.25
0.25
0.25
0.25""")  # "Class 5 building Class 7 warehouse Class 8 Labs Class 9 Clinic _ Weekday"
class_5_building_class_7_warehouse_class_2 = Panel("""0.25
0.25
0.25
0.25
0.25
0.25
0.25
0.25
0.25
0.25
0.25
0.25
0.25
0.25
0.25
0.25
0.25
0.25
0.25
0.25
0.25
0.25
0.25
0.25""")  # "Class 5 building Class 7 warehouse Class 8 Labs Class 9 Clinic _ Weekend"
class_5_building_class_7_warehouse_class_3 = Panel("""0.15
0.15
0.15
0.15
0.15
0.15
0.15
0.15
0.25
0.25
0.25
0.25
0.25
0.25
0.25
0.25
0.25
0.15
0.15
0.15
0.15
0.15
0.15
0.15""")  # "Class 5 building Class 7 warehouse Class 8 Labs Class 9 Clinic _ Weekend"
class_5_building_class_7_warehouse_class_4 = Panel("""0.15
0.15
0.15
0.15
0.15
0.15
0.15
0.40
0.90
1
1
1
1
1
1
1
1
0.80
0.60
0.60
0.50
0.15
0.15
0.15""")  # "Class 5 building Class 7 warehouse Class 8 Labs Class 9 Clinic _ Weekday"
class_5_building_class_7_warehouse_class_5 = Panel("""0
0
0
0
0
0
0
1
1
1
1
1
1
1
1
1
1
1
0
0
0
0
0
0""")  # "Class 5 building Class 7 warehouse Class 8 Labs Class 9 Clinic _ Weekday"
class_5_building_class_7_warehouse_class_6 = Panel("""0
0
0
0
0
0
0
0
0
0
0
0
0
0
0
0
0
0
0
0
0
0
0
0""")  # "Class 5 building Class 7 warehouse Class 8 Labs Class 9 Clinic _ Weekend"
class_5_building_7_warehouse_8_labs_9a_c = Panel("""0
0
0
0
0
0
0
0
0.05
0.05
0.05
0.05
0.05
0.05
0.05
0.05
0.05
0
0
0
0
0
0
0""")  # "Class 5 building, 7 warehouse, 8 Labs, 9a clinic_Weekend"
class_5_building_7_warehouse_8_labs_9a_c_2 = Panel("""0
0
0
0
0
0
0
0.1
0.2
0.7
0.7
0.7
0.7
0.7
0.7
0.7
0.7
0.35
0.1
0.05
0.05
0
0
0""")  # "Class 5 building, 7 warehouse, 8 Labs, 9a clinic_Weekday"
class_9b_theather_cinema_weekend = Panel("""0
0
0
0
0
0
0
1
1
1
1
1
1
1
1
1
1
1
1
1
1
1
1
1""")
class_9b_theather_cinema = Panel("")
class_9b_theather_cinema_weekday = Panel("""0
0
0
0
0
0
0
0
0
0
0
1
1
1
1
1
1
1
1
1
1
1
1
1""")
class_6_shop_or_shopping_centre = Panel("""0
0
0
0
0
0
0
0.10
0.20
0.20
0.15
0.25
0.25
0.15
0.15
0.15
0.15
0.05
0.05
0
0
0
0
0""")
class_6_restaurant_or_café = Panel("""0
0
0
0
0
0
0
1
1
1
1
1
1
1
1
1
1
1
1
1
1
1
1
1""")
class_9b_theather_or_cinema = Panel("""0
0
0
0
0
0
0
0
0
0
0
0
0.20
0.70
0.70
0.70
0.70
0.20
0.20
0.70
0.70
0.70
0.70
0.10""")
class_9b_conference_facilities = Panel("")
class_9b_conference_facilities_2 = Panel("""0
0
0
0
0
0
1
1
1
1
1
1
1
1
1
1
1
1
1
1
1
1
1
0""")
class_9b_conference_facility = Panel("""0
0
0
0
0
0
0.05
0.10
0.20
0.20
0.25
0.30
0.30
0.35
0.30
0.30
0.35
0.25
0.20
0.15
0.10
0.10
0.10
0.05""")
class_9b_conference_facilities_3 = Panel("""0.15
0.15
0.15
0.15
0.15
0.15
0.25
0.45
0.45
0.45
0.60
0.60
0.60
0.60
0.45
0.60
0.60
0.60
0.60
0.25
0.25
0.25
0.25
0.25""")
class_2_common_area = Panel("""0
0
0
0
0
0
0
0
0
0
0
0
0
0
0
0
0
0
0
0
0
0
0
0""")
class_3_hotel = Panel("""0.9
0.9
0.9
0.9
0.9
0.8
0.7
0.6
0.6
0.3
0.1
0.1
0.1
0.1
0.1
0.1
0.2
0.3
0.4
0.5
0.6
0.7
0.7
0.9""")
class_9b_theather_cinema_2 = Panel("""0.05
0.05
0.05
0.05
0.05
0.05
0.05
0.05
1
0.10
0.10
0.10
1
0.05
0.05
0.05
0.05
1
1
1
0.05
0.05
0.05
1""")
class_6_restautant_or_cafe = Panel("""0
0
0
0
0
0
0.05
0.05
0.05
0.05
0.20
0.50
0.80
0.70
0.40
0.20
0.25
0.50
0.80
0.80
0.80
0.50
0.35
0.20""")
class_9a_ward = Panel("1")
class_6_shop = Panel("""0.25
0.25
0.25
0.25
0.25
0.25
0.25
0.70
0.70
0.70
0.70
0.70
0.70
0.70
0.70
0.70
0.70
0.70
0.70
0.10
0.10
0.10
0.10
0.10""")
class_6_restaurant_or_café_2 = Panel("""0.05
0.05
0.05
0.05
0.05
0.05
0.40
0.40
0.60
0.60
0.90
0.90
0.90
0.90
0.90
0.90
0.90
0.90
0.90
0.90
0.90
0.90
0.50
0.30""")
class_3_hotel_2 = Panel("""0.05
0.05
0.05
0.05
0.05
0.25
0.80
0.80
0.50
0.20
0.20
0.20
0.20
0.20
0.20
0.20
0.20
0.50
0.50
0.50
0.50
0.50
0.50
0.50""")
class_3_hotel_3 = Panel("""0.20
0.20
0.15
0.15
0.15
0.15
0.40
0.80
0.50
0.30
0.20
0.20
0.20
0.20
0.20
0.20
0.20
0.40
0.40
0.50
0.60
0.60
0.40
0.20""")
class_6_restaurant_or_café_3 = Panel("""0.15
0.15
0.15
0.15
0.15
0.15
0.40
0.40
0.60
0.60
0.90
0.90
0.90
0.90
0.90
0.90
0.90
0.90
0.90
0.90
0.90
0.90
0.50
0.30""")
class_9b_school = Panel("""0
0
0
0
0
0
0
1
1
1
1
1
1
1
1
1
1
0
0
0
0
0
0
0""")
class_2_common_area_2 = Panel("""0.30
0.30
0.30
0.30
0.30
0.30
0.50
0.50
0.50
0.50
0.50
0.50
0.50
0.50
0.50
0.50
0.50
0.50
0.50
0.50
0.50
0.50
0.50
0.30""")
class_9a_ward_2 = Panel("""1
1
1
1
1
1
1
1
1
1
1
1
1
1
1
1
1
1
1
1
1
1
1
1""")
class_6_shop_2 = Panel("""0
0
0
0
0
0
0
1
1
1
1
1
1
1
1
1
1
1
0
0
0
0
0
0""")
class_2_common_area_3 = Panel("""1
1
1
1
1
1
1
1
1
1
1
1
1
1
1
1
1
1
1
1
1
1
1
1""")
class_6_shop_3 = Panel("""0.25
0.25
0.25
0.25
0.25
0.25
0.25
1
1
1
1
1
1
1
1
1
1
1
1
0.10
0.10
0.10
0.10
0.10""")
class_3_hotel_4 = Panel("""1
1
1
1
1
1
1
1
1
1
1
0
0
0
0
0
0
1
1
1
1
1
1
1""")
class_2_common_area_4 = Panel("""0
0
0
0
0
0
0
0
0
0
0
0
0
0
0
0
0
0
0
0
0
0
0
0""")
class_9b_school_2 = Panel("""0
0
0
0
0
0
0
0.05
0.75
0.90
0.90
0.90
0.50
0.50
0.90
0.70
0.50
0.20
0.20
0.20
0.10
0.05
0.05
0.05""")
class_9b_school_3 = Panel("""0.05
0.05
0.05
0.05
0.05
0.05
0.05
0.30
0.85
0.95
0.95
0.95
0.70
0.70
0.95
0.80
0.60
0.20
0.20
0.20
0.10
0.05
0.05
0.05""")
class_9b_school_4 = Panel("""0.05
0.05
0.05
0.05
0.05
0.05
0.05
0.30
0.85
0.95
0.95
0.95
0.80
0.80
0.95
0.90
0.70
0.20
0.20
0.20
0.10
0.05
0.05
0.05""")
class_9a_ward_3 = Panel("""0.70
0.70
0.70
0.70
0.70
0.70
0.70
0.70
0.70
0.70
0.70
0.70
0.70
0.70
0.70
0.70
0.70
0.70
0.70
0.70
0.70
0.70
0.70
0.70""")
class_9a_ward_4 = Panel("""0.05
0.05
0.05
0.05
0.05
0.25
0.80
0.80
0.50
0.20
0.20
0.20
0.20
0.20
0.20
0.20
0.20
0.50
0.50
0.50
0.50
0.50
0.50
0.05""")
graft = GraftTree(
    Tree=[class_2_common_area_2, class_3_hotel_2, class_5_building_class_7_warehouse_class_4, class_6_shop_3, class_6_restaurant_or_café_2, class_9a_ward_4, class_9b_theather_cinema_2, class_9b_conference_facilities_3, class_9b_school_4],
    IncludeEmptyLists=True,
    IncludeNullItems=True)
graft_2 = GraftTree(
    Tree=[class_2_common_area_2, class_3_hotel_2, class_5_building_class_7_warehouse_class_3, class_6_shop_3, class_6_restaurant_or_café_2, class_9a_ward_4, class_9b_theather_cinema_2, class_9b_conference_facilities_3, class_9b_school_4],
    IncludeEmptyLists=True,
    IncludeNullItems=True)
graft_3 = GraftTree(
    Tree=[class_2_common_area_4, class_5_building_class_7_warehouse_class, class_3_hotel_3, class_9b_school_3, class_9b_conference_facilities, class_6_shop, class_9b_theather_cinema, class_6_restaurant_or_café_3, class_9a_ward],
    IncludeEmptyLists=True,
    IncludeNullItems=True)
graft_4 = GraftTree(
    Tree=[class_2_common_area_4, class_5_building_class_7_warehouse_class_2, class_3_hotel_3, class_9b_school_3, class_9b_conference_facilities, class_6_shop, class_9b_theather_cinema, class_6_restaurant_or_café_3, class_9a_ward],
    IncludeEmptyLists=True,
    IncludeNullItems=True)
graft_5 = GraftTree(
    Tree=[class_2_common_area, class_3_hotel, class_5_building_7_warehouse_8_labs_9a_c_2, class_6_shop_or_shopping_centre, class_6_restautant_or_cafe, class_9a_ward_3, class_9b_theather_or_cinema, class_9b_conference_facility, class_9b_school_2],
    IncludeEmptyLists=True,
    IncludeNullItems=True)
graft_6 = GraftTree(
    Tree=[class_2_common_area, class_3_hotel, class_5_building_7_warehouse_8_labs_9a_c, class_6_shop_or_shopping_centre, class_6_restautant_or_cafe, class_9a_ward_3, class_9b_theather_or_cinema, class_9b_conference_facility, class_9b_school_2],
    IncludeEmptyLists=True,
    IncludeNullItems=True)
graft_7 = GraftTree(
    Tree=[class_2_common_area_3, class_3_hotel_4, class_5_building_class_7_warehouse_class_5, class_6_shop_2, class_6_restaurant_or_café, class_9a_ward_2, class_9b_theather_cinema_weekday, class_9b_conference_facilities_2, class_9b_school],
    IncludeEmptyLists=True,
    IncludeNullItems=True)
graft_8 = GraftTree(
    Tree=[class_2_common_area_3, class_3_hotel_4, class_5_building_class_7_warehouse_class_6, class_6_shop_2, class_6_restaurant_or_café, class_9a_ward_2, class_9b_theather_cinema_weekend, class_9b_conference_facilities_2, class_9b_school],
    IncludeEmptyLists=True,
    IncludeNullItems=True)
branch = TreeBranch(Tree=graft_2, Path=concat, MaintainPaths=True)
branch_2 = TreeBranch(Tree=graft, Path=concat, MaintainPaths=True)
branch_3 = TreeBranch(Tree=graft_4, Path=concat, MaintainPaths=True)
branch_4 = TreeBranch(Tree=graft_3, Path=concat, MaintainPaths=True)
branch_5 = TreeBranch(Tree=graft_5, Path=concat, MaintainPaths=True)
branch_6 = TreeBranch(Tree=graft_6, Path=concat, MaintainPaths=False)
branch_7 = TreeBranch(Tree=graft_7, Path=concat, MaintainPaths=True)
branch_8 = TreeBranch(Tree=graft_8, Path=concat, MaintainPaths=True)
# Appliances/equipment
# Weekend
panel = Panel("")
panel_2 = Panel("""True
False""")
split = TextSplit(Text=branch)
panel_3 = Panel("""True
False""")
split_2 = TextSplit(Text=branch_2)
panel_4 = Panel("""True
False""")
panel_5 = Panel("""True
False""")
panel_6 = Panel("""True
False""")
split_3 = TextSplit(Text=branch_3, Separators=panel)
split_4 = TextSplit(Text=branch_4)
split_5 = TextSplit(Text=branch_5)
panel_7 = Panel("""True
False""")
panel_8 = Panel("""True
False""")
split_6 = TextSplit(Text=branch_6)
panel_9 = Panel("""True
False""")
split_7 = TextSplit(Text=branch_8)
split_8 = TextSplit(Text=branch_7)
# Artificial Lighting
# Week Day
cull = CullPattern(List=split_2, CullPattern=panel_3)
# Artificial Lighting
# Weekend
cull_2 = CullPattern(List=split, CullPattern=panel_4)
cull_3 = CullPattern(List=split_3, CullPattern=panel_8)
# Appliances/equipment
# Week Day
cull_4 = CullPattern(List=split_4, CullPattern=panel_2)
# Occupancy
# Weekend
cull_5 = CullPattern(List=split_6, CullPattern=panel_9)
# Occupancy
# Week Day
cull_6 = CullPattern(List=split_5, CullPattern=panel_7)
# AC Weekend
cull_7 = CullPattern(List=split_7, CullPattern=panel_5)
equals = Equality(FirstNumber=cull_7, SecondNumber=1)  # -> Equality, Inequality
replace = ReplaceMembers(Set=equals.Equality, Find="False", Replace="0.5")
# AC Week Day
cull_8 = CullPattern(List=split_8, CullPattern=panel_6)
equals_2 = Equality(FirstNumber=cull_8, SecondNumber=1)  # -> Equality, Inequality
replace_2 = ReplaceMembers(Set=equals_2.Equality, Find="False", Replace="0.5")
weeklyschedule = HBWeeklySchedule(sun=replace, mon=replace_2, tue=replace_2, wed=replace_2, thu=replace_2, fri=replace_2, sat=replace, name="Infiltration")  # -> report, schedule, idf_year, idf_week, idf_days; plug-in component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
weeklyschedule_2 = HBWeeklySchedule(sun=cull_3, mon=cull_4, tue=cull_4, wed=cull_4, thu=cull_4, fri=cull_4, sat=cull_3, name="Equipment")  # -> report, schedule, idf_year, idf_week, idf_days; plug-in component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
annualschedule = Honeybee_AnnualSchedule(
    sun=cull_5,
    mon=cull_6,
    tue=cull_6,
    wed=cull_6,
    thu=cull_6,
    fri=cull_6,
    sat=cull_5,
    scheduleName="Occupancy",
    runIt=Toggle(True))  # -> readMe, port, schedule, port_2, weekSched, schedIDFText; plug-in component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
weeklyschedule_3 = HBWeeklySchedule(sun=cull_5, mon=cull_6, tue=cull_6, wed=cull_6, thu=cull_6, fri=cull_6, sat=cull_5, name="Occupancy")  # -> report, schedule, idf_year, idf_week, idf_days; plug-in component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
weeklyschedule_4 = HBWeeklySchedule(sun=cull_2, mon=cull, tue=cull, wed=cull, thu=cull, fri=cull, sat=cull_2, name="Lighting")  # -> report, schedule, idf_year, idf_week, idf_days; plug-in component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
weeklyschedule_5 = HBWeeklySchedule(sun=cull_7, mon=cull_8, tue=cull_8, wed=cull_8, thu=cull_8, fri=cull_8, sat=cull_7, name="AC", type_limit="On-Off")  # -> report, schedule, idf_year, idf_week, idf_days; plug-in component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
schedule = ClusterOutput(weeklyschedule_2.schedule)
schedule_2 = ClusterOutput(weeklyschedule.schedule)
schedule_3 = ClusterOutput(weeklyschedule_4.schedule)
weeksched = ClusterOutput(annualschedule.weekSched)
schedule_4 = ClusterOutput(weeklyschedule_3.schedule)
schedule_5 = ClusterOutput(weeklyschedule_5.schedule)
annualschedule_2 = Honeybee_AnnualSchedule(
    sun=replace,
    mon=replace_2,
    tue=replace_2,
    wed=replace_2,
    thu=replace_2,
    fri=replace_2,
    sat=replace,
    scheduleName="Infiltration",
    runIt=Toggle(True))  # -> readMe, port, schedule, port_2, weekSched, schedIDFText; plug-in component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
annualschedule_3 = Honeybee_AnnualSchedule(
    sun=cull_3,
    mon=cull_4,
    tue=cull_4,
    wed=cull_4,
    thu=cull_4,
    fri=cull_4,
    sat=cull_3,
    scheduleName="Equipment",
    runIt=Toggle(True))  # -> readMe, port, schedule, port_2, weekSched, schedIDFText; plug-in component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
annualschedule_4 = Honeybee_AnnualSchedule(
    sun=cull_7,
    mon=cull_8,
    tue=cull_8,
    wed=cull_8,
    thu=cull_8,
    fri=cull_8,
    sat=cull_7,
    scheduleName="AC",
    runIt=Toggle(True))  # -> readMe, port, schedule, port_2, weekSched, schedIDFText; plug-in component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
annualschedule_5 = Honeybee_AnnualSchedule(sun=cull_2, mon=cull, tue=cull, wed=cull, thu=cull, fri=cull, sat=cull_2, scheduleName="Lighting", runIt=Toggle(True))  # -> readMe, port, schedule, port_2, weekSched, schedIDFText; plug-in component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
weeksched_2 = ClusterOutput(annualschedule_2.weekSched)
weeksched_3 = ClusterOutput(annualschedule_3.weekSched)
weeksched_4 = ClusterOutput(annualschedule_4.weekSched)
weeksched_5 = ClusterOutput(annualschedule_5.weekSched)
